# Grasshopper definition JitteryVoronoi.gh (Grasshopper 1.0.7)
# plug-ins: Kangaroo2 Components

# ----
# Generate a voronoi from random or custom points
number_slider = Slider(10, range=0..10)
rectangle = Rectangle(Plane=PlaneXY(0, 0, 0), XSize=number_slider, YSize=Slider(10, range=0..10), Radius=0)  # -> Rectangle, Length
pop2d = Populate2D(Region=rectangle.Rectangle, Count=Slider(43, range=0..100), Seed=Slider(29, range=0..100))
voronoi = Voronoi(Points=pop2d, Boundary=rectangle.Rectangle, BruteForceOverride=False)

crv = Curve(voronoi)

# ----
# Noise Parameters
noise_amplitude = Slider(0.149, range=0..1)
noise_interval = Slider(0.299, range=0..1)
noise_seed = Slider(69, range=0..100)

# ----
# Adding noise to your curves
explode = Explode(Curve=crv, Recursive=True)  # -> Segments, Vertices
flatten = FlattenTree(Tree=explode.Segments, Path="{0}")
dupln = RemoveDuplicateLines(Lines=flatten, Tolerance=0.01)
flatten_2 = FlattenTree(Tree=dupln, Path="{0}")
explode_2 = Explode(Curve=flatten_2, Recursive=True)  # -> Segments, Vertices
graft = GraftTree(Tree=explode_2.Vertices, IncludeEmptyLists=True, IncludeNullItems=True)
trim = TrimTree(Tree=graft, Depth=1)
pline = PolyLine(Vertices=trim, Closed=False)
divlength = DivideLength(Curve=pline, Length=noise_interval)  # -> Points, Tangents, Parameters
end = EndPoints(Curve=pline)  # -> Start, End
simplify = SimplifyTree(Tree=divlength.Points, Front=False)
simplify_2 = SimplifyTree(Tree=end.End, Front=False)
merge = Merge(Data1=simplify, Data2=simplify_2)
end_2 = EndPoints(Curve=pline)  # -> Start, End
neg = Negative(Value=noise_amplitude)
dom = ConstructDomain(DomainStart=neg, DomainEnd=noise_amplitude)
lng = ListLength(List=merge)
equals = Equality(FirstNumber=end_2.Start, SecondNumber=merge)  # -> Equality, Inequality
equals_2 = Equality(FirstNumber=end_2.End, SecondNumber=merge)  # -> Equality, Inequality
random = Random(Range=dom, Number=lng, Seed=noise_seed)
multiplication = Multiplication(A=equals.Inequality, B=equals_2.Inequality)
unit = UnitVector(Vector=pline)
Z = UnitZ(Factor=1)
number = Number(1.570796327)
multiplication_2 = Multiplication(A=random, B=multiplication)
vrot = Rotate(Vector=unit, Axis=Z, Angle=number)
amp = Amplitude(Vector=vrot, Amplitude=multiplication_2)
move = Move(Geometry=merge, Motion=amp)  # -> Geometry, Transform
intcrv = Interpolate(Vertices=move.Geometry, Degree=3, Periodic=False, KnotStyle=1)  # -> Curve, Length, Domain
pline_2 = PolyLine(Vertices=move.Geometry, Closed=False)

crv_2 = Curve(intcrv.Curve)
crv_3 = Curve(pline_2)
